vi "index.gviweb"   [G Web Development Software 22.3.0]
panel indicators:
  "Cluster": T1
  "body": string
types:
  T1 = cluster{"Sensor Value": f64, "Connection": bool, "Calibration data": string}
uses:
  NI::HTTP::Open HTTP Handle.gvi
  NI::HTTP::GET.gvi
  NI::HTTP::Close HTTP Handle.gvi
diagram:
  call "Open HTTP Handle.gvi"() -> (client handle out=w1, error out=w2)
  # Top-Level WebVIs usually contain a While Loop that never stops so that they can continue running as long as the web page is open in the user's web browser.
  s1 = w1  # shift register
  s2 = w2  # shift register
  while {
    call "GET.gvi"(client handle=s1, url="https://ge-iot-ad599-default-rtdb.firebaseio.com/data.json", error in=s2) -> (client handle out=w3, body=w4, error out=w5)
    $body <- w4
    Unflatten From Json(JSON string=w4, type and defaults=T1 {all zero or empty}) -> (value=w6)
    $Cluster <- w6
    Wait(time to wait=50)
    next s1 = w3
    next s2 = w5
    stop if FALSE
  }
  call "Close HTTP Handle.gvi"(client handle=s1, error in=s2)
